# Grasshopper definition A2 Try 1.gh (Grasshopper 1.0.7)

off_center_slit_by = Slider(-2, range=-50..50)
slit_distance_from_center = Slider(48, range=0..100)
slit_width = Slider(3, range=0..100)
slit_length = Slider(20, range=0..100)
polygon_radius = Slider(48, range=0..100)
number_of_sides = Slider(6, range=3..100)
division = Division(A=slit_width, B=off_center_slit_by)
subtraction = Subtraction(A=slit_distance_from_center, B=slit_length)
shape_polygon = Polygon(Plane=PlaneXY(0, 0, 0), Radius=polygon_radius, Segments=number_of_sides, FilletRadius=0)  # -> Polygon, Length
rectangular_slit = Rectangle(Plane=PlaneXY(0, 0, 0), XSize=slit_width, YSize=slit_length, Radius=0)  # -> Rectangle, Length
vector_xyz_slit_positioning = VectorXYZ(XComponent=division, YComponent=subtraction, ZComponent=0)  # -> Vector, Length
move_slits = Move(Geometry=rectangular_slit.Rectangle, Motion=vector_xyz_slit_positioning.Vector)  # -> Geometry, Transform
rotate_slits_by_radians = Slider(-11, range=-50..50)
polar_array_replicate_slits = PolarArray(Geometry=move_slits.Geometry, Plane=PlaneXY(0, 0, 0), Count=number_of_sides, Angle=6.283185307)  # -> Geometry, Transform
rotate_slit = Rotate(Geometry=polar_array_replicate_slits.Geometry, Angle=rotate_slits_by_radians, Plane=PlaneXY(0, 0, 0))  # -> Geometry, Transform
trim_with_regions_polygon = TrimWithRegions(Curve=shape_polygon.Polygon, Regions=rotate_slit.Geometry)  # -> Inside, flatten(Outside)
trim_with_regions_slit = TrimWithRegions(Curve=rotate_slit.Geometry, Regions=shape_polygon.Polygon)  # -> flatten(Inside), Outside
vector_xyz = VectorXYZ(XComponent=0, YComponent=0, ZComponent=slit_width)  # -> Vector, Length
join_curves = JoinCurves(Curves=[trim_with_regions_slit.Inside, trim_with_regions_polygon.Outside], Preserve=False)
brep_fill_shape = Brep(join_curves)
extrude = Extrude(Base=brep_fill_shape, Direction=vector_xyz.Vector)
